# Grasshopper definition aaro.gh (Grasshopper 0.9.76)

number_slider = Slider(0.902, range=0.2..5)
number_slider_2 = Slider(84, range=20..200)
_90 = Integer(90)
number_slider_3 = Slider(78, range=0..100)
pt = ConstructPoint(XCoordinate=0, YCoordinate=0, ZCoordinate=0)
multiplication = Multiplication(A=_90, B=Slider(8, range=0..20))
recgrid = Rectangular(Plane=PlaneXY(0, 0, 0), SizeX=number_slider, SizeY=number_slider, ExtentX=number_slider_2, ExtentY=number_slider_2)  # -> Cells, Points
cir = Circle(Plane=pt, Radius=Slider(44.674, range=0..100))
division = Division(A=multiplication, B=number_slider_3)
pframes = PerpFrames(Curve=cir, Count=number_slider_3, Align=True)  # -> Frames, Parameters
image = ImageSampler(
    recgrid.Points,
    FilePath="D:\imageedit_2_8877395592.gif",
    Filter="Value",
    Interpolate=True,
    Umax=30,
    Umin=0,
    Vmax=30,
    Vmin=0,
    Wrap=1)
series = Series(Start=Slider(67.866, range=0..100), Step=division, Count=number_slider_3)
polygon = Polygon(Plane=pframes.Frames, Radius=Slider(11.259, range=0..100), Segments=Slider(4, range=0..10), FilletRadius=0)  # -> Polygon, Length
rad = Radians(Degrees=series)
Z = UnitZ(Factor=1)
amp = Amplitude(Vector=pframes.Frames, Amplitude=Slider(3.221, range=0..10))
rotate = Rotate(Geometry=polygon.Polygon, Angle=rad, Plane=pframes.Frames)  # -> Geometry, Transform
circle = CircleCNR(Center=recgrid.Points, Normal=Vector(0, 0, 1), Radius=image)
extr = Extrude(Base=circle, Direction=Z)
extr_2 = Extrude(Base=rotate.Geometry, Direction=amp)
cap = CapHoles(Brep=extr_2)
